# Grasshopper definition Curve analysis.gh (Grasshopper 1.0.8)
# plug-ins: RhinoCodePluginGH

crv = Curve(<curve referenced from the Rhino model>)
py3 = Python3Script(t=Slider(0.6447, range=0..1), c=crv)  # -> out, p, helpers; inputs t: Double, c: Curve
# ---------- py3: Python ----------
import rhinoscriptsyntax as rs
import scriptcontext as sc
import math

import System
import System.Collections.Generic
import Rhino


def AccessKnots(nc):
        # NurbsCurve.GrevilleParameters always returns all parameters, even for
    # perodic curves. Otherwise, it would not be possible to determine
    # which subset of the full list of Greville abcissae was returned.
    t_list = nc.GrevilleParameters()
    
    # Filter out what we don't want so it looks like what we'd see if
    # we ran the EditPtOn command
    if t_list:
        t = 0
        t_count = t_list.Count
        if nc.IsPeriodic:
            t_count -= nc.Order - 1
            rc = 0
            while True:
                if rc < nc.Order - 1 and t_list[t] < nc.Knots[nc.Order-2]:
                    rc += 1
                    t += 1
                    continue
                break
        elif nc.IsClosed:
            t_count -= 1
            
        for n in range(t, t + t_count):
            helpers.append(rs.AddPoint(nc.PointAt(t_list[n])))

#  SCRIPT BEGINS HERE
print(type(c))
crv = rs.coercecurve(c)
print(type(crv))

helpers = []

nc = crv.ToNurbsCurve()
print(type(nc))   

pointlist = nc.Points
for i in range(pointlist.Count):
    apoint = pointlist[i]
    print(apoint.Location)
    helpers.append(rs.AddPoint(apoint.Location))
AccessKnots(nc)
# ---------- end py3 ----------
geo = Geometry(py3.helpers)
panel = Panel(py3.p)
