# Grasshopper definition Curves 01 - 2 point curve.gh (Grasshopper 1.0.8)
# plug-ins: RhinoCodePluginGH

pt = Point(<point referenced from the Rhino model>)
pt_2 = Point(<point referenced from the Rhino model>)
py3 = Python3Script(t=Slider(0.6447, range=0..1), p1=pt, p2=pt_2)  # -> out, p; inputs t: Double, p1: Point3d, p2: Point3d
# ---------- py3: Python ----------
import rhinoscriptsyntax as rs
import scriptcontext as sc
import math

import System
import System.Collections.Generic
import Rhino


#p  = p1 + (p2 - p1) * t
'''
    = p1 + p2 * t - p1 * t
    = p1 - (p1 * t) + p2 * t 
    = p1 * (1 - t)  + p2 * t
'''
p = (1-t)*p1 + t*p2
# ---------- end py3 ----------
panel = Panel(py3.p)
