# Grasshopper definition Curves 02 - 3 point curve.gh (Grasshopper 1.0.8)
# plug-ins: RhinoCodePluginGH

pt = Point(<point referenced from the Rhino model>)
pt_2 = Point(<point referenced from the Rhino model>)
pt_3 = Point(<point referenced from the Rhino model>)
py3 = Python3Script(p1=pt, p2=pt_3, p3=pt_2)  # -> out, c; inputs p1: Point3d, p2: Point3d; disabled
# ---------- py3: Python ----------
import rhinoscriptsyntax as rs
import scriptcontext as sc
import math
import numpy

import System
import System.Collections.Generic
import Rhino

c = []
ts = numpy.arange(0,1.1, 0.1)

for t in ts:
    p12 = (1 - t) * p1 + t * p2
    p23 = (1 - t) * p2 + t * p3
    p =   (1 - t) * p12 + t * p23
    c.append(rs.AddPoint(p))
# ---------- end py3 ----------
py3_2 = Python3Script(t=Slider(0.7679, range=0..1), p1=pt, p2=pt_3, p3=pt_2)  # -> out, p, helpers; inputs t: Double, p1: Point3d, p2: Point3d, p3: Point3d
# ---------- py3_2: Python ----------
import rhinoscriptsyntax as rs
import scriptcontext as sc
import math

import System
import System.Collections.Generic
import Rhino
import rhinoscriptsyntax as rs

helpers = []


p12 = (1 - t) * p1 + t * p2
p23 = (1 - t) * p2 + t * p3
p =   (1 - t) * p12 + t * p23
helpers.append(p12)
helpers.append(p23)
helpers.append(rs.AddLine(p1, p2))
helpers.append(rs.AddLine(p2, p3))
helpers.append(rs.AddLine(p12, p23))
# ---------- end py3_2 ----------
pt_4 = Point(py3_2.p)
geo = Geometry(py3_2.helpers)
