# Grasshopper definition Surface 01 - evaluate surface.gh (Grasshopper 1.0.7)
# plug-ins: RhinoCodePluginGH

srf = Surface(<surface referenced from the Rhino model>)
py3 = Python3Script(s=srf, u=Slider(24.2, range=0..100), v=Slider(47.1, range=0..100))  # -> out, Puv, Cu, Cv; inputs s: Surface, u: Double, v: Double
# ---------- py3: Python ----------
import rhinoscriptsyntax as rs
import scriptcontext as sc
import math
import numpy

import System
import System.Collections.Generic
import Rhino

print("U Domain: ", s.Domain(0).Min, " to: ", s.Domain(0).Max )
print("V Domain: ", s.Domain(1).Min, " to: ", s.Domain(1).Max )
print("U Degree: ", s.Degree(0) )
print("V Degree: ", s.Degree(1) )
Puv = s.PointAt(u, v)
Cu = s.IsoCurve(1, u)
Cv = s.IsoCurve(0, v)
# ---------- end py3 ----------
panel = Panel(py3.out)
crv = Curve(py3.Cu)
pt = Point(py3.Puv)
crv_2 = Curve(py3.Cv)
panel_2 = Panel(py3.Cu)
