# Grasshopper definition Surface 02 - points on surface.gh (Grasshopper 1.0.7)
# plug-ins: RhinoCodePluginGH

srf = Surface(<surface referenced from the Rhino model>)
py3 = Python3Script(s=srf, n=Slider(5, range=0..30), m=Slider(12, range=0..30))  # -> out, points; inputs s: Surface, n: Double, m: Double
# ---------- py3: Python ----------
import rhinoscriptsyntax as rs
import scriptcontext as sc
import math
import numpy

import System
import System.Collections.Generic
import Rhino

uvals = numpy.arange(s.Domain(0).Min, s.Domain(0).Max, s.Domain(0).Max / n)
#numpy.append(uvals, s.Domain(0).Max)

vvals = numpy.arange(s.Domain(1).Min, s.Domain(1).Max, s.Domain(1).Max / m)
#numpy.append(vvals, s.Domain(1).Max)

points = []

for u in uvals:
    #newrow = []
    #points.append(newrow)
    for v in vvals:
        #newrow.append(s.PointAt(u,v))
        Puv = s.PointAt(u,v)
        points.append(Puv)
# ---------- end py3 ----------
panel = Panel(py3.points)
panel_2 = Panel(py3.out)
crv = Curve()
pt = Point(py3.points)
crv_2 = Curve()
