# Grasshopper definition explodeBREP.gh (Grasshopper 1.0.8)

A = Slider(9.2, range=0..20)
brep = Brep(<brep referenced from the Rhino model>)
py3 = Python3Script(brep=brep, dis=A)  # -> out, A; inputs brep: Brep
# ---------- py3: Python ----------
import Rhino

#get the brep center
area = Rhino.Geometry.AreaMassProperties.Compute(brep)
brep_center = area.Centroid

#get a list of faces
faces = brep.Faces

#decalre variables
exploded_faces = []

#loop through all faces
for i, face in enumerate(faces):

	#get a duplicate of the face
	extracted_face = faces.ExtractFace(i)
	
	#get the center of each face
	area = Rhino.Geometry.AreaMassProperties.Compute(extracted_face)
	center = area.Centroid
	
	#calculate move direction (from brep centroid to face center)
	direction = center - brep_center
	direction.Unitize()
	direction *= dis
	
	#move the extracted face
	move = Rhino.Geometry.Transform.Translation(direction)
	extracted_face.Transform(move)
	
	#add to exploded_faces list
	exploded_faces.append(extracted_face)

#assign exploded list of faces to output
A = exploded_faces
# ---------- end py3 ----------
panel = Panel(py3.out)
geo = Geometry(py3.A)
