# Grasshopper definition makeMesh00 - start.gh (Grasshopper 1.0.8)
# plug-ins: RhinoCodePluginGH

number_slider = Slider(3, range=0..50)
int = Integer(Slider(3, range=0..101))
smartmesh = Python3Script(sizeX=Slider(20, range=0..100), sizeY=Slider(20, range=0..100), countX=int, countY=int)  # -> out, vertices, mesh; inputs sizeX: Double, sizeY: Double, countX: Double, countY: Double
# ---------- smartmesh: Python ----------
import rhinoscriptsyntax as rs
import scriptcontext as sc
import math
import numpy

import System
import System.Collections.Generic
import Rhino
from System import Object

def VID(i, j):
    return j * countX + i

def V(i, j):
    return vertices(VID(i, j))

#make x values
xvals = numpy.arange(0, sizeX, sizeX / float(countX - 1))
xvals = numpy.append(xvals, sizeX)
#print(xvals)
countX = xvals.size

#make y values
yvals = numpy.arange(0, sizeY, sizeY / float(countY - 1))
yvals = numpy.append(yvals, sizeY)
yCount = yvals.size


#create the vertices that the edges will reference later
vertices = []
faceVertices = []

#making the vertices
for y in yvals:
    for x in xvals:
        vertices.append((x,y,0))

#indexing into the vertices to make the faces
j = 0
for y in yvals:
    i = 0
    for x in xvals:
        #do something
        faceVertices.append((VID(i,j), VID(i+i, j),  VID(i+i, j+1)))
        print(VID(i,j), " " ,  VID(i+i, j), " " , VID(i+i, j+1))
        faceVertices.append((VID(i,j), VID(i+i, j+1),  VID(i, j+1)))
        i = i + 1
    j = j + 1
              




mesh = rs.AddMesh( vertices, faceVertices )
# ---------- end smartmesh ----------
panel = Panel(smartmesh.out)
mesh = Mesh(smartmesh.mesh)
pt = Point()
panel_2 = Panel(smartmesh.vertices)
demesh = DeconstructMesh(Mesh=mesh)  # -> Vertices, Faces, Colours, Normals
medges = MeshEdges(Mesh=mesh)  # -> NakedEdges, InteriorEdges, NonManifoldEdges
line = Line(medges.NakedEdges)
line_2 = Line(medges.InteriorEdges)
line_3 = Line(medges.NonManifoldEdges)
panel_3 = Panel(demesh.Vertices)
panel_4 = Panel(demesh.Faces)
panel_5 = Panel(demesh.Colours)
panel_6 = Panel(demesh.Normals)
