# Grasshopper definition makeMesh01.gh (Grasshopper 1.0.8)

number_slider = Slider(3, range=0..50)
int = Integer(Slider(3, range=0..101))
smartmesh = Python3Script(sizeX=Slider(20, range=0..100), sizeY=Slider(20, range=0..100), countX=int, countY=int)  # -> out, flatten(vertices), mesh; inputs sizeX: Double, sizeY: Double, countX: Double, countY: Double
# ---------- smartmesh: Python ----------
import rhinoscriptsyntax as rs
import scriptcontext as sc
import math
import numpy

import System
import System.Collections.Generic
import Rhino
from System import Object

#index helper functions
def VID(i, j):
    return j * countX + i
def V(i, j):
    return vertices(VID(i, j))

#make x values
xvals = numpy.arange(0, sizeX, sizeX / float(countX - 1))
xvals = numpy.append(xvals, sizeX)
#print(xvals)
countX = xvals.size

#make y values
yvals = numpy.arange(0, sizeY, sizeY / float(countY - 1))
yvals = numpy.append(yvals, sizeY)
yCount = yvals.size

#create the vertices that the edges will reference later
vertices = []
for y in yvals:
    i = 0
    for x in xvals:
        vertices.append((x,y,0.0))

# make the face vertex lists
faceVertices = []
j = 0
for y in yvals:
    i = 0
    for x in xvals:
        if (i < countX - 1) and (j < countY - 1):
                #### forward faces
                faceVertices.append((VID(i,j), VID(i+1,j), VID(i+1,j+1)))
                faceVertices.append((VID(i,j), VID(i+1,j+1), VID(i,j+1)))  
        i = i + 1
    j = j + 1

#Make the mesh
mesh = rs.AddMesh( vertices, faceVertices )
# ---------- end smartmesh ----------
panel = Panel(smartmesh.out)
mesh = Mesh(smartmesh.mesh)
panel_2 = Panel(smartmesh.vertices)
demesh = DeconstructMesh(Mesh=mesh)  # -> Vertices, Faces, Colours, Normals
medges = MeshEdges(Mesh=mesh)  # -> NakedEdges, InteriorEdges, NonManifoldEdges
line = Line(medges.NakedEdges)
line_2 = Line(medges.InteriorEdges)
line_3 = Line(medges.NonManifoldEdges)
panel_3 = Panel(demesh.Vertices)
panel_4 = Panel(demesh.Faces)
panel_5 = Panel(demesh.Colours)
panel_6 = Panel(demesh.Normals)
