# Grasshopper definition makeMesh03 - with texture coordinates.gh (Grasshopper 1.0.8)
# plug-ins: RhinoCodePluginGH

number_slider = Slider(3, range=0..50)
int = Integer(Slider(21, range=0..101))
smartmesh = Python3Script(sizeX=Slider(20, range=0..100), sizeY=Slider(20, range=0..100), countX=int, countY=int)  # -> out, flatten(vertices), mesh; inputs sizeX: Double, sizeY: Double, countX: Double, countY: Double
# ---------- smartmesh: Python ----------
import rhinoscriptsyntax as rs
import scriptcontext as sc
import math
import numpy

import System
import System.Collections.Generic
import Rhino
from System import Object

def VID(i, j):
    return j * countX + i

def V(i, j):
    return vertices(VID(i, j))

#make x values
xvals = numpy.arange(0, sizeX, sizeX / float(countX - 1))
xvals = numpy.append(xvals, sizeX)
#print(xvals)
countX = xvals.size

#make y values
yvals = numpy.arange(0, sizeY, sizeY / float(countY - 1))
yvals = numpy.append(yvals, sizeY)
yCount = yvals.size


#create the vertices that the edges will reference later

vertices = []
textcoords = []
j = 0
vid = 0
for y in yvals:
    i = 0
    for x in xvals:
        vertices.append((x,y,0.0))

        # some different texture coordinates
        textcoords.append((x ,y))
        #textcoords.append((x / sizeX ,y / sizeY))
        #textcoords.append((x*x / sizeX ,1/y / sizeY))
        #textcoords.append((math.sin(x / sizeX * 2*math.pi),y / sizeY))
        #print(vid, ": (", x, ", " , y, ")")


faceVertices = []

# make the face vertex lists
j = 0
for y in yvals:
    i = 0
    for x in xvals:

        if (i < countX - 1) and (j < countY - 1):
                #### forward faces
                faceVertices.append((VID(i,j), VID(i+1,j), VID(i+1,j+1)))
                faceVertices.append((VID(i,j), VID(i+1,j+1), VID(i,j+1)))
                  
        i = i + 1
    j = j + 1

#Make the mesh
mesh = rs.AddMesh( vertices, faceVertices, texture_coordinates= textcoords )
# ---------- end smartmesh ----------
panel = Panel(smartmesh.out)
mesh = Mesh(smartmesh.mesh)
panel_2 = Panel(smartmesh.vertices)
demesh = DeconstructMesh(Mesh=mesh)  # -> Vertices, Faces, Colours, Normals
medges = MeshEdges(Mesh=mesh)  # -> NakedEdges, InteriorEdges, NonManifoldEdges
line = Line(medges.NakedEdges)
line_2 = Line(medges.InteriorEdges)
line_3 = Line(medges.NonManifoldEdges)
panel_3 = Panel(demesh.Vertices)
panel_4 = Panel(demesh.Faces)
panel_5 = Panel(demesh.Colours)
panel_6 = Panel(demesh.Normals)
