# Grasshopper definition makeMesh04 - cubecolors.gh (Grasshopper 1.0.8)
# plug-ins: RhinoCodePluginGH

number_slider = Slider(3, range=0..50)
number_slider_2 = Slider(20, range=0..100)
int = Integer(Slider(3, range=0..101))
makecube = Python3Script(lng=Slider(20, range=0..100))  # -> out, flatten(vertices), mesh; inputs lng: Double
# ---------- makecube: Python ----------
import rhinoscriptsyntax as rs
import scriptcontext as sc
import math
import numpy
import random

import System
import System.Collections.Generic
import Rhino
from System import Object

def VID(i, j):
    return j * countX + i

def V(i, j):
    return vertices(VID(i, j))


#create the vertices that the edges will reference later
vertices = []
vertices.append((0,0,0))
vertices.append((lng,0,0))
vertices.append((0,lng,0))
vertices.append((lng,lng,0))

vertices.append((0,0,lng))
vertices.append((lng,0,lng))
vertices.append((0,lng,lng))
vertices.append((lng,lng,lng))

vcolors = []
for i in range(8):
#   vcolors.append(rs.CreateColor(int(random.uniform(0,256)), int(random.uniform(0,256)), int(random.uniform(0,256))))
    vcolors.append(rs.CreateColor(int(vertices[i][0] / lng * 255), int(vertices[i][1] / lng * 255), int(vertices[i][2] / lng * 255)))

faceVertices = []

faceVertices.append((0,2,3,1)) #bottom
faceVertices.append((0,1,5,4)) #front
faceVertices.append((1,3,7,5)) #right
faceVertices.append((2,3,7,6)) #back
faceVertices.append((0,4,6,2)) #left
faceVertices.append((4,5,7,6)) #top


print(vcolors)
#Make the mesh
mesh = rs.AddMesh( vertices, faceVertices, vertex_colors = vcolors )
# ---------- end makecube ----------
panel = Panel(makecube.out)
mesh = Mesh(makecube.mesh)
panel_2 = Panel(makecube.vertices)
demesh = DeconstructMesh(Mesh=mesh)  # -> Vertices, Faces, Colours, Normals
medges = MeshEdges(Mesh=mesh)  # -> NakedEdges, InteriorEdges, NonManifoldEdges
line = Line(medges.NakedEdges)
line_2 = Line(medges.InteriorEdges)
line_3 = Line(medges.NonManifoldEdges)
panel_3 = Panel(demesh.Vertices)
panel_4 = Panel(demesh.Faces)
panel_5 = Panel(demesh.Colours)
panel_6 = Panel(demesh.Normals)
