# Grasshopper definition analyzeMesh.gh (Grasshopper 1.0.8)

mesh = Mesh(<mesh referenced from the Rhino model>)
demesh = DeconstructMesh(Mesh=mesh)  # -> Vertices, Faces, Colours, Normals
medges = MeshEdges(Mesh=mesh)  # -> NakedEdges, InteriorEdges, NonManifoldEdges
panel = Panel(demesh.Vertices)
panel_2 = Panel(demesh.Faces)
panel_3 = Panel(demesh.Colours)
panel_4 = Panel(demesh.Normals)
line = Line(medges.NakedEdges)
line_2 = Line(medges.InteriorEdges)
line_3 = Line(medges.NonManifoldEdges)
