# Grasshopper definition basic TT XLS READ.gh (Grasshopper 1.0.8)
# plug-ins: CORE.Toolbox.Grasshopper

path = FilePath("G:\My Drive\CASE\Students\Courses\_All Semesters\DP2\Classes\Class 08 - Data 1 - tables\ttread.xlsx")
xl_in = ReadFromExcel(WorkbookFilepath=path, Live=Toggle(True), Stream=Toggle(True))

item = ListItem(List=xl_in, Index=Slider(1, range=0..10), Wrap=True)
panel = Panel(item)

item_2 = ListItem(List=flatten(item), Index=Slider(3, range=0..10), Wrap=True)
panel_2 = Panel(item_2)

panel_3 = Panel(xl_in)
