# Grasshopper definition basic TT XLS WRITE.gh (Grasshopper 1.0.8)
# plug-ins: CORE.Toolbox.Grasshopper

path = FilePath("G:\My Drive\CASE\Students\Courses\_All Semesters\DP2\Classes\Class 08 - Data 1 - tables\ttwrite.xlsx")
random = Random(Range=Domain(0, 1), Number=Slider(10, range=0..10), Seed=2)  # -> graft(Random)
xl_out = WriteToExcelClassic(WorkbookFilepath=path, Data=random, LocationAddress="A1", Clear=0, Stream=Toggle(True))
panel = Panel(random)
panel_2 = Panel(xl_out)
