# Grasshopper definition data logging.gh (Grasshopper 1.0.8)
# plug-ins: CORE.Toolbox.Grasshopper

trigger = Trigger(Interval=1000, TimerInterval=1000, Target=[py3, py3_2])
stream = BooleanToggle(True)
reset = Button()
py3 = Python3Script(reset=reset, run=stream)  # -> out, i, sinout, cosout; inputs reset: Boolean
# ---------- py3: Python ----------
import scriptcontext as rs
import math
 
#if (not rs.sticky["someName"]):
if not 'DRS' in rs.sticky.keys():
    rs.sticky["DRS"] = 0

if reset:
    rs.sticky["DRS"] = 0

i = rs.sticky["DRS"]

sinout = math.sin(i * math.pi / 180)
cosout = math.cos(i * math.pi / 180)

if run: rs.sticky["DRS"] = i + 1
# ---------- end py3 ----------
py3_2 = Python3Script()  # -> out, a, H, M, S
# ---------- py3_2: Python ----------
from datetime import datetime

now = datetime.now()

print(now)
# 2022-09-20 10:27:21.240752
H = now.hour
M = now.minute
S = now.second
# ---------- end py3_2 ----------
panel = Panel(py3.i)
panel_2 = Panel(py3_2.out)
panel_3 = Panel(py3.sinout)
panel_4 = Panel(py3.cosout)
concat = Concatenate(FragmentA=py3_2.H, FragmentB=":", FragmentC=py3_2.M, FragmentD=":", FragmentE=py3_2.S)
txt = Text(flatten([concat, panel_3, panel_4]))
path = FilePath("C:\Users\sheldd\iCloudDrive\_ACADEMIC\_COURSES\Design Programming II 2024\Prep\Class 07 - Data 1\output.csv")
tracker = ValueTracker(
    [panel_3, panel_4],
    TrackerAutoDomain=True,
    TrackerColour=RGB(255, 155, 0),
    TrackerPeriod=10,
    TrackerUpdate=25,
    TrackerDomain=[0, 1])
path_2 = FilePath("C:\Users\sheldd\iCloudDrive\_ACADEMIC\_COURSES\Design Programming II 2025\Prep\Class 07 - Data 1 - tables\ttwrite.xlsx")
panel_5 = Panel(txt)
concat_2 = Concatenate(FragmentA="A", FragmentB=panel)
xl_out = WriteToExcelClassic(WorkbookFilepath=path_2, Data=txt, LocationAddress=concat_2, Clear=0, Stream=stream)
