# Grasshopper definition array in class.gh (Grasshopper 1.0.8)
# plug-ins: RhinoCodePluginGH

py3 = Python3Script()  # -> out, keys, values
# ---------- py3: Python ----------
thisdict1 = {
    "brand":"Ford",
    "model":"Mustang",
    "year":1964
    }


thisdict2 = {
    "brand":"Ford",
    "model":"Mustang",
    "year":1967
    }

mySmallArray = ["A", "B", "C"]

length = len(mySmallArray)

#print(length)

for element in mySmallArray:
    print(element)

for count in range(len(mySmallArray)):
    print(mySmallArray[count])

myData = [thisdict1, thisdict2]




keys = thisdict1.keys()
values = thisdict1.values()

#for i in keys:
    #print(thisdict1[i])
# ---------- end py3 ----------
panel = Panel(py3.out)
