# Grasshopper definition basic dictionary.gh (Grasshopper 1.0.8)
# plug-ins: RhinoCodePluginGH

py3 = Python3Script()  # -> out, keys, values
# ---------- py3: Python ----------
thisdict = {
    "brand":"Ford",
    "model":"Mustang",
    "year":1964
    }

keys = thisdict.keys()
values = thisdict.values()

for i in keys:
    print(thisdict[i])
# ---------- end py3 ----------
