# Grasshopper definition import JSON.gh (Grasshopper 1.0.8)
# plug-ins: RhinoCodePluginGH

path = FilePath("C:\Users\sheldd\iCloudDrive\_ACADEMIC\_COURSES\Design Programming II 2024\Prep\Class 07 - Data 1\testData.JSON")
py3 = Python3Script(path=path)  # -> out, xText, xData
# ---------- py3: Python ----------
import json


f = open(path, "r")
xText = f.read()

# parse (load) TEXT to DATA
xData = json.loads(xText)

# the result is a Python dictionary:

print(xData[2]["brand"])
# ---------- end py3 ----------
py3_2 = Python3Script(xText="{ \"name\":\"John\", \"age\":30, \"city\":\"New York\"}")  # -> out, xData
# ---------- py3_2: Python ----------
"""Grasshopper Script"""

import json


# parse x:
xData = json.loads(xText)

xData["color"] = "red"

# the result is a Python dictionary:
#print(xData["name"])

print(type(xData.keys()))
print(xData.values())
# ---------- end py3_2 ----------
panel = Panel(py3.xData)
panel_2 = Panel(py3.out)
panel_3 = Panel(py3.xText)
panel_4 = Panel(py3_2.out)
panel_5 = Panel(py3_2.xData)
