# Grasshopper definition sticky base example.gh (Grasshopper 1.0.8)

trigger = Trigger(Interval=1000, TimerInterval=1000, Target=[py3_2, py3_3])
py3 = Python3Script(reset=Button())  # -> out, a
# ---------- py3: Python ----------
import random
import Rhino.Geometry as rg
import scriptcontext as sc

if (reset and sc.sticky.has_key("DRS")):
    print("reset!")
    sc.sticky.pop("DRS")
# ---------- end py3 ----------
py3_2 = Python3Script()  # -> out, a
# ---------- py3_2: Python ----------
import random
import Rhino.Geometry as rg
import scriptcontext as sc



if sc.sticky.has_key("DRS"):
    print("has key!")
    myInstance = sc.sticky["DRS"]
    print(myInstance)

else: 
    print("no key!")
    myInstance = random.random()
    sc.sticky["DRS"] = myInstance 
    print(myInstance)
# ---------- end py3_2 ----------
py3_3 = Python3Script()  # -> out, a
# ---------- py3_3: Python ----------
import random
import Rhino.Geometry as rg
import scriptcontext as sc



if sc.sticky.has_key("DRS"):
    print("has key!")
    myInstance = sc.sticky["DRS"]

else: 
    print("no key!")
    myInstance = random.random()
    sc.sticky["DRS"] = myInstance 
       
print(myInstance)
# ---------- end py3_3 ----------
panel = Panel(py3_2.out)
panel_2 = Panel(py3_3.out)
panel_3 = Panel(py3.out)
