# Grasshopper definition 01. UserDictionary.gh (Grasshopper 1.0.8)
# plug-ins: RhinoCodePluginGH

geo = Geometry(<surface referenced from the Rhino model>)
num = Number(5)
py3 = Python3Script(x=geo, key="DRS", value=num)  # -> out, a
# ---------- py3: Python ----------
x.UserDictionary.Set(key, value)
a = x
# ---------- end py3 ----------
geo_2 = Geometry(py3.a)
py3_2 = Python3Script(x=py3.a, key="DRS")  # -> out, value
# ---------- py3_2: Python ----------
_, value = x.UserDictionary.TryGetValue(key)
print(value)
# ---------- end py3_2 ----------
panel = Panel(py3_2.value)
