# Grasshopper definition 02. recursion.gh (Grasshopper 1.0.8)
# plug-ins: RhinoCodePluginGH

py3 = Python3Script(depth=Slider(3, range=0..10))  # -> out, a; inputs depth: Int32
# ---------- py3: Python ----------
"""Grasshopper Script"""

def iter(level, astring):
    print (astring)
    if level >= 0:
        iter(int(level - 1), astring + str(level) + "L")
        iter(int(level - 1), astring + str(level) + "R")    

iter(depth, "")
# ---------- end py3 ----------
panel = Panel(py3.out)
