# Grasshopper definition 04. tree_list_tree.gh (Grasshopper 1.0.8)
# plug-ins: RhinoCodePluginGH

panel = Panel("""1
2
3""")
panel_2 = Panel("""a
b
c""")
line = Line(Line((0, 0, 0), (10, 10, 0)))
box = Box({Plane=PlaneXY(-17.38781117, -9.785726393, 0), X=Domain(0, 4.482602728), Y=Domain(0, 4.058462887), Z=Domain(0, 6.765692237)})
graft = GraftTree(Tree=[line, box], IncludeEmptyLists=True, IncludeNullItems=True)
int = Integer(panel)
graft_2 = GraftTree(Tree=panel_2, IncludeEmptyLists=True, IncludeNullItems=True)
graft_3 = GraftTree(Tree=int, IncludeEmptyLists=True, IncludeNullItems=True)
py3 = Python3Script(depth=Slider(1, range=0..10))  # -> out, a; inputs depth: Int32
# ---------- py3: Python ----------
"""Grasshopper Script"""

def iter(level, retlist):
    if level >= 0:
        print(level)
        retlist.append(iter(int(level - 1), []))
        retlist.append(iter(int(level - 1), []))   
        return(retlist)
    else: return 0

b = iter(depth, [])
c = []
c.append(b)
a = c
# ---------- end py3 ----------
panel_3 = Panel(py3.a)
data = Data([graft_2, graft_3, graft])
panel_4 = Panel(data)
list_to_tree = Python3Script(x=py3.a)  # -> out, a
# ---------- list_to_tree: Python ----------
def list_to_tree(input, none_and_holes=True, source=[0]):
    """Transforms nestings of lists or tuples to a Grasshopper DataTree"""
    from Grasshopper import DataTree
    from Grasshopper.Kernel.Data import GH_Path as Path
    import System
    from System import Array
      
    def proc(input,tree,track):
        path = Path(Array[int](track))
        if len(input) == 0 and none_and_holes: tree.EnsurePath(path); return
        for i,item in enumerate(input):
            if hasattr(item, '__iter__'): #if list or tuple
                track.append(i); proc(item,tree,track); track.pop()
            else:
                if none_and_holes: tree.Insert(item,path,i)
                elif item is not None: tree.Add(item,path)
    if input is not None: 
        t=DataTree[System.Object]()
        proc(input,t,source[:])
        return t


# written by Giulio Piacentino, giulio@mcneel.com
def tree_to_list(input, retrieve_base = lambda x: x[0]):
    """Returns a list representation of a Grasshopper DataTree"""
    def extend_at(path, index, simple_input, rest_list):
        target = path[index]
        if len(rest_list) <= target: rest_list.extend([None]*(target-len(rest_list)+1))
        if index == path.Length - 1:
            rest_list[target] = list(simple_input)
        else:
            if rest_list[target] is None: rest_list[target] = []
            extend_at(path, index+1, simple_input, rest_list[target])
    all = []
    for i in range(input.BranchCount):
        path = input.Path(i)
        extend_at(path, 0, input.Branch(path), all)
    return retrieve_base(all)

a = list_to_tree(x)
# ---------- end list_to_tree ----------
tree_to_list = Python3Script(x=data)  # -> out, a; inputs x: tree
# ---------- tree_to_list: Python ----------
def list_to_tree(input, none_and_holes=True, source=[0]):
    """Transforms nestings of lists or tuples to a Grasshopper DataTree"""
    from Grasshopper import DataTree as Tree
    from Grasshopper.Kernel.Data import GH_Path as Path
    from System import Array
    def proc(input,tree,track):
        path = Path(Array[int](track))
        if len(input) == 0 and none_and_holes: tree.EnsurePath(path); return
        for i,item in enumerate(input):
            if hasattr(item, '__iter__'): #if list or tuple
                track.append(i); proc(item,tree,track); track.pop()
            else:
                if none_and_holes: tree.Insert(item,path,i)
                elif item is not None: tree.Add(item,path)
    if input is not None: t=Tree[object]();proc(input,t,source[:]);return t


# written by Giulio Piacentino, giulio@mcneel.com
def tree_to_list(input, retrieve_base = lambda x: x[0]):
    """Returns a list representation of a Grasshopper DataTree"""
    def extend_at(path, index, simple_input, rest_list):
        target = path[index]
        if len(rest_list) <= target: rest_list.extend([None]*(target-len(rest_list)+1))
        if index == path.Length - 1:
            rest_list[target] = list(simple_input)
        else:
            if rest_list[target] is None: rest_list[target] = []
            extend_at(path, index+1, simple_input, rest_list[target])
    all = []
    for i in range(input.BranchCount):
        path = input.Path(i)
        extend_at(path, 0, input.Branch(path), all)
    return retrieve_base(all)

b = tree_to_list(x)
a = []
a.append(b)
# ---------- end tree_to_list ----------
panel_5 = Panel(list_to_tree.a)
panel_6 = Panel(tree_to_list.a)
panel_7 = Panel(list_to_tree.out)
