# Grasshopper definition json-parse and dump.gh (Grasshopper 1.0.8)
# plug-ins: RhinoCodePluginGH

py3 = Python3Script()  # -> out, xText, xData, yText, yData
# ---------- py3: Python ----------
"""Grasshopper Script"""

import json

# some JSON:
xText =  '{ "name":"John", "age":30, "city":"New York"}'
# parse x:
xData = json.loads(xText)

yData = {
    "name": "Sally",
    "age" : 25,
    "city": "Washington, DC"
}

yText = json.dumps(yData)

# the result is a Python dictionary:
print(xData["name"])

print(yData["name"])
# ---------- end py3 ----------
py3_2 = Python3Script(xText="{ \"name\":\"John\", \"age\":30, \"city\":\"New York\"}")  # -> out, xData
# ---------- py3_2: Python ----------
"""Grasshopper Script"""

import json


# parse x:
xData = json.loads(xText)

xData["color"] = "red"

# the result is a Python dictionary:
#print(xData["name"])

print(type(xData.keys()))
print(xData.values())
# ---------- end py3_2 ----------
panel = Panel(py3.out)
panel_2 = Panel(py3.xData)
panel_3 = Panel(py3.xText)
panel_4 = Panel(py3.yText)
panel_5 = Panel(py3.yData)
panel_6 = Panel(py3_2.out)
panel_7 = Panel(py3_2.xData)
