# Grasshopper definition Eto 5.0 Synapse 01.gh (Grasshopper 1.0.8)
# plug-ins: Synapse

stoggle = SnpToggle(Property=flatten("Width"), PropertyValue=flatten("1000"))  # -> AllProperties, Control
svalq = SnpValueQuery(SynapseObject=stoggle.Control, Update=True)
panel = Panel(svalq)
panel_2 = Panel(stoggle.AllProperties)

panel_3 = Panel("""1000
200
500""")
panel_4 = Panel("""MaxValue
Width
MinValue""")
sintsl = SnpIntSlider(Property=flatten(panel_4), PropertyValue=flatten(panel_3))  # -> AllProperties, Control
svalq_2 = SnpValueQuery(SynapseObject=sintsl.Control, Update=True)
panel_5 = Panel(svalq_2)
panel_6 = Panel(sintsl.AllProperties)

slabel = SnpTextLabel(Property=flatten("Text"), PropertyValue=flatten("My Label"))  # -> AllProperties, Control

panel_7 = Panel(slabel.AllProperties)

# ---- group: Window controls
merge = Merge(Data1=sintsl.Control, Data2=slabel.Control, Data3=stoggle.Control)
sstack = SnpStack(Controls=flatten(merge))  # -> AllProperties, Control
swin = SnpWindow(Show=Toggle(True), Contents=flatten(sstack.Control), ctrlfill=True, ctrlredo=False, ghowned=False, uitheme=True)  # -> AllProperties, Window
panel_8 = Panel(swin.AllProperties)
panel_9 = Panel(swin.Window)
