# Grasshopper definition synapse in class.gh (Grasshopper 1.0.8)
# plug-ins: Synapse

panel = Panel("""100
1000""")
panel_2 = Panel("""minValue
maxValue""")
sintsl = SnpIntSlider(Property=flatten(panel_2), PropertyValue=flatten(panel))  # -> AllProperties, Control
stoggle = SnpToggle()  # -> AllProperties, Control
merge = Merge(Data1=sintsl.Control, Data2=stoggle.Control)
svalq = SnpValueQuery(SynapseObject=sintsl.Control, Update=True)
svalq_2 = SnpValueQuery(SynapseObject=stoggle.Control, Update=True)
sstack = SnpStack(Controls=flatten(merge))  # -> AllProperties, Control
panel_3 = Panel(svalq_2)
panel_4 = Panel(svalq)
swin = SnpWindow(Show=Toggle(False), Contents=flatten(sstack.Control), ctrlfill=True, ctrlredo=False, ghowned=False, uitheme=True)  # -> AllProperties, Window
