# Grasshopper definition 01 - Recursion.gh (Grasshopper 1.0.8)

maketree = Python3Script(levels=Slider(3, range=0..10))  # -> out, a; inputs levels: Int32
# ---------- maketree: Python ----------
"""Grasshopper Script"""

def iter(level):
    newtree = []
    if level == 0:
        global i
        i += 1
        ret = [i]
        return ret

    newtree.append(iter(level - 1))
    newtree.append(iter(level - 1))
    return newtree

i = 0
a = []
a.append(iter(levels))
print(a)
# ---------- end maketree ----------
panel = Panel(maketree.a)
panel_2 = Panel(maketree.out)
traversetree = Python3Script(t=maketree.a)  # -> out, a
# ---------- traversetree: Python ----------
"""Grasshopper Script"""

def iter(tree, ret):
    #print(type(tree))
    if isinstance(tree, list):
        for i in tree:
            iter(i, ret)
            #print(ret)
    else:
        if isinstance(tree, int):
            ret.append(tree)

 
ret = []
iter(t, ret)
print(ret)
# ---------- end traversetree ----------
panel_3 = Panel(traversetree.out)
