# Grasshopper definition 02 - Tree Recursion - 5 branches.gh (Grasshopper 1.0.8)

number_slider = Slider(0.4421, range=0..1)
number_slider_2 = Slider(0.3384, range=0..1)
pt = Point(<point referenced from the Rhino model>)
pt_2 = Point(<point referenced from the Rhino model>)
py3 = Python3Script(p0=pt, p1=pt_2, length=Slider(1.5568, range=0..10), scale=number_slider, width=number_slider_2)  # -> out, a; disabled
# ---------- py3: Python ----------
import rhinoscriptsyntax as rs
import Rhino
import math

def iter(p0, p1):
    print("level deeper")
    a.append(rs.AddLine(p0, p1))

    p03d = Rhino.Geometry.Point3d(p0)
    p13d = Rhino.Geometry.Point3d(p1)

    p0p1vec = p13d - p03d # Vector p0->p1
    p0p1VecLen = p0p1vec.Length #calculate distance
    # find the unit vector perpendicular to p0p1
    vcross = Rhino.Geometry.Vector3d.CrossProduct(p0p1vec,Rhino.Geometry.Vector3d.ZAxis)
    vcross.Unitize() 

    p2a = p1 + p0p1vec * scale +  vcross * p0p1VecLen * scale * width
    p2b = p1 + p0p1vec * scale -  vcross * p0p1VecLen * scale * width
    # a different approach - terminates based on some condition not level
    if (p0p1VecLen < length):
        return
        
    
    iter(p1, p2a) 
    iter(p1, p2b) 

a = []


P0 = rs.coerce3dpoint(p0)
P1 = rs.coerce3dpoint(p1)
iter(Rhino.Geometry.Point3d(P0), Rhino.Geometry.Point3d(P1))
# ---------- end py3 ----------
py3_2 = Python3Script(p0=pt, p1=pt_2, levels=Slider(3, range=0..10), scale=number_slider, width=number_slider_2)  # -> out, a
# ---------- py3_2: Python ----------
import rhinoscriptsyntax as rs
import Rhino
import math

def iter(p0, p1, level):
    a.append(rs.AddLine(p0, p1))

    p03d = Rhino.Geometry.Point3d(p0)
    p13d = Rhino.Geometry.Point3d(p1)

    p0p1vec = p13d - p03d # Vector p0->p1
    p0p1VecLen = p0p1vec.Length #calculate distance
    # find the unit vector perpendicular to p0p1
    vcross = Rhino.Geometry.Vector3d.CrossProduct(p0p1vec,Rhino.Geometry.Vector3d.ZAxis)
    vcross.Unitize() 

    p2a = p1 + p0p1vec * scale +  vcross * p0p1VecLen * scale * width
    p2b = p1 + p0p1vec * scale 
    p2c = p1 + p0p1vec * scale -  vcross * p0p1VecLen * scale * width
    p2d = p1 + p0p1vec * scale +  vcross * p0p1VecLen * scale * 2 * width
    p2e = p1 + p0p1vec * scale -  vcross * p0p1VecLen * scale * 2 * width

    if (level == 0):
        return
        
    
    iter(p1, p2a, level - 1) 
    iter(p1, p2b, level - 1) 
    iter(p1, p2c, level - 1) 
    iter(p1, p2d, level - 1) 
    iter(p1, p2e, level - 1) 

a = []


P0 = rs.coerce3dpoint(p0)
P1 = rs.coerce3dpoint(p1)
iter(Rhino.Geometry.Point3d(P0), Rhino.Geometry.Point3d(P1), levels)
# ---------- end py3_2 ----------
panel = Panel(py3_2.out)
panel_2 = Panel(py3.out)
