# Grasshopper definition 03 - Koch Curve.gh (Grasshopper 1.0.8)

number_slider = Slider(10, range=0..10)  # disabled
pt = Point(<point referenced from the Rhino model>)
pt_2 = Point(<point referenced from the Rhino model>)
py3 = Python3Script(p0=pt, p1=pt_2, length=number_slider)  # -> out, a; disabled
# ---------- py3: Python ----------
import rhinoscriptsyntax as rs
import Rhino
import math

def iter(p0, p4):
    p1 = (p0 * 2.0 + p4) / 3.0
    p3 = (p0  + p4 * 2.0) / 3.0
    pmid = (p0 + p4) / 2.0

    p0p4vec = p4 - p0
    p0p4len = p0p4vec.Length

    vcross = Rhino.Geometry.Vector3d.CrossProduct(p0p4vec,Rhino.Geometry.Vector3d.ZAxis)
    vcross.Unitize() 

    p2 = pmid - vcross * p0p4len / 6.0 * math.sqrt(3)

    if (p0p4len < length):
        a.append(rs.AddLine(p0, p4))
        return
        
    
    iter(p0, p1) 
    iter(p1, p2) 
    iter(p2, p3) 
    iter(p3, p4) 

a = []
iter(rs.coerce3dpoint(p0), rs.coerce3dpoint(p1))
# ---------- end py3 ----------
py3_2 = Python3Script(p0=pt, p1=pt_2, levels=Slider(0, range=0..10))  # -> out, a
# ---------- py3_2: Python ----------
import rhinoscriptsyntax as rs
import Rhino
import math

def iter(p0, p4, level):
    p1 = (p0 * 2.0 + p4) / 3.0
    p3 = (p0  + p4 * 2.0) / 3.0
    pmid = (p0 + p4) / 2.0

    p0p4vec = p4 - p0
    p0p4len = p0p4vec.Length

    vcross = Rhino.Geometry.Vector3d.CrossProduct(p0p4vec,Rhino.Geometry.Vector3d.ZAxis)
    vcross.Unitize() 

    p2 = pmid - vcross * p0p4len / 6.0 * math.sqrt(3)

    if (level == 0):
        a.append(rs.AddLine(p0, p4))
        return
        
    
    iter(p0, p1, level - 1) 
    iter(p1, p2, level - 1) 
    iter(p2, p3, level - 1) 
    iter(p3, p4, level - 1) 

a = []
iter(rs.coerce3dpoint(p0), rs.coerce3dpoint(p1), levels)
# ---------- end py3_2 ----------
panel = Panel(py3_2.out)
