# Grasshopper definition 04 - Sierpinski Gasket.gh (Grasshopper 1.0.8)

pt = Point(<point referenced from the Rhino model>)
pt_2 = Point(<point referenced from the Rhino model>)
py3 = Python3Script(p0=pt, p1=pt_2, levels=Slider(3, range=0..10))  # -> out, a
# ---------- py3: Python ----------
import rhinoscriptsyntax as rs
import Rhino
import math

def iter(p00, p33, level):


    p00p33vec = p33 - p00
    xvec = Rhino.Geometry.Vector3d(p00p33vec[0] / 3.0, 0, 0)
    yvec = Rhino.Geometry.Vector3d(0, p00p33vec[1] / 3.0, 0)

    #p00 from input
    p01 = p00 + xvec
    p02 = p01 + xvec
    p03 = p02 + xvec

    p10 = p00 + yvec   
    p11 = p10 + xvec   
    p12 = p11 + xvec
    p13 = p12 + xvec

    p20 = p10 + yvec   
    p21 = p20 + xvec   
    p22 = p21 + xvec
    p23 = p22 + xvec

    p30 = p20 + yvec   
    p31 = p30 + xvec   
    p32 = p31 + xvec
    #p33 from input

    if (level == 0):
        curvepts = []
        curvepts.append(p00)
        curvepts.append(p03)
        curvepts.append(p33)
        curvepts.append(p30)
        curvepts.append(p00)
        a.append(rs.AddPolyline(curvepts))
        return
        
    
    iter(p00, p11, level - 1) 
    iter(p01, p12, level - 1) 
    iter(p02, p13, level - 1) 

    iter(p10, p21, level - 1) 
#    iter(p11, p22, level - 1) 
    iter(p12, p23, level - 1) 

    iter(p20, p31, level - 1) 
    iter(p21, p32, level - 1) 
    iter(p22, p33, level - 1) 


a = []
iter(rs.coerce3dpoint(p0), rs.coerce3dpoint(p1), levels)
# ---------- end py3 ----------
panel = Panel(py3.out)
