# Grasshopper definition 05. tree manipulations.gh (Grasshopper 1.0.8)

series = Series(Start=0, Step=1, Count=10)
series_2 = Series(Start=0, Step=1, Count=10)
crossref = CrossReference(ListA=series, ListB=series, CrossMode=1)  # -> ListA, ListB
panel = Panel(crossref.ListA)
flatten = FlattenTree(Tree=series_2, Path="{0}")
graft = GraftTree(Tree=flatten, IncludeEmptyLists=True, IncludeNullItems=True)
simplify = SimplifyTree(Tree=graft, Front=False)
pt = ConstructPoint(XCoordinate=crossref.ListA, YCoordinate=crossref.ListB, ZCoordinate=0)
panel_2 = Panel(simplify)
path_mapper = PathMapper(series, source="{A;B}(i)", target="{A;B;i}")
panel_3 = Panel(flatten)
panel_4 = Panel(series_2)
panel_5 = Panel(graft)
viewer = ParamViewer(panel_2)
viewer_2 = ParamViewer(flatten)
viewer_3 = ParamViewer(simplify)
viewer_4 = ParamViewer(panel_5)
viewer_5 = ParamViewer(graft)
viewer_6 = ParamViewer(series_2)
viewer_7 = ParamViewer(series_2)
viewer_8 = ParamViewer(flatten)
panel_6 = Panel(path_mapper)
viewer_9 = ParamViewer(panel_6)
viewer_10 = ParamViewer(path_mapper)
