# Grasshopper definition 06 Tree Conversion.gh (Grasshopper 1.0.8)

# ---- group: LIST CREATION
make_list = Python3Script(levels=Slider(3, range=0..10))  # -> out, a
# ---------- make_list: Python ----------
"""Grasshopper Script"""
def iter(level):
    newtree = []
    if level == 0:
        global i
        i += 1
        ret = [i]
        return ret

    newtree.append(iter(level - 1))
    newtree.append(iter(level - 1))
    return newtree

i = 0
a = []
a.append(iter(levels))
print(a)
# ---------- end make_list ----------
panel = Panel(make_list.a)

# ---- group: LIST TO TREE
list_to_tree = Python3Script(inputlist=make_list.a)  # -> out, a
# ---------- list_to_tree: Python ----------
import Rhino
import Grasshopper as gh
from Grasshopper import DataTree
from Grasshopper.Kernel.Data import GH_Path

# Create a Grasshopper DataTree
tree = DataTree[object]()

def add_to_tree(tree, data, path):
    """
    Recursively traverses a nested list and adds items to the Grasshopper DataTree.
    
    Parameters:
    - tree: Grasshopper DataTree to populate
    - data: Current level of the nested list
    - path: GH_Path representing the current branch
    """
    if isinstance(data, list):
        for i, item in enumerate(data):
            # Extend the path with the current index
            new_path = path.AppendElement(i)
            add_to_tree(tree, item, new_path)
    else:
        # Add the item to the tree
        tree.Add(data, path)

# Initialize with an empty path
initial_path = GH_Path()

# Add the nested list data to the tree
add_to_tree(tree, inputlist, initial_path)

# Output the tree to Grasshopper
a = tree
# ---------- end list_to_tree ----------
viewer = ParamViewer(list_to_tree.a)
panel_2 = Panel(list_to_tree.a)

# ---- group: TREE BRANCH AND ITEM
branch = TreeBranch(Tree=list_to_tree.a, Path="{0;0;1;0}", MaintainPaths=True)
item = TreeItem(Tree=list_to_tree.a, Path="{0;0;1;0}", Index=0, Wrap=True)
viewer_2 = ParamViewer(branch)
panel_3 = Panel(item)

# ---- group: TREE_TO_LIST (Buggy)
list_to_tree_2 = Python3Script(x=list_to_tree.a)  # -> out, a; inputs x: tree
# ---------- list_to_tree_2: Python ----------
def list_to_tree(input, none_and_holes=True, source=[0]):
    """Transforms nestings of lists or tuples to a Grasshopper DataTree"""
    from Grasshopper import DataTree
    from Grasshopper.Kernel.Data import GH_Path as Path
    import System
    from System import Array
      
    def proc(input,tree,track):
        path = Path(Array[int](track))
        if len(input) == 0 and none_and_holes: tree.EnsurePath(path); return
        for i,item in enumerate(input):
            if hasattr(item, '__iter__'): #if list or tuple
                track.append(i); proc(item,tree,track); track.pop()
            else:
                if none_and_holes: tree.Insert(item,path,i)
                elif item is not None: tree.Add(item,path)
    if input is not None: 
        t=DataTree[System.Object]()
        proc(input,t,source[:])
        return t


# written by Giulio Piacentino, giulio@mcneel.com
def tree_to_list(input, retrieve_base = lambda x: x[0]):
    """Returns a list representation of a Grasshopper DataTree"""
    def extend_at(path, index, simple_input, rest_list):
        target = path[index]
        if len(rest_list) <= target: rest_list.extend([None]*(target-len(rest_list)+1))
        if index == path.Length - 1:
            rest_list[target] = list(simple_input)
        else:
            if rest_list[target] is None: rest_list[target] = []
            extend_at(path, index+1, simple_input, rest_list[target])
    all = []
    for i in range(input.BranchCount):
        path = input.Path(i)
        extend_at(path, 0, input.Branch(path), all)
    return retrieve_base(all)

a = tree_to_list(x)
# ---------- end list_to_tree_2 ----------
list_to_tree_3 = Python3Script(inputlist=list_to_tree_2.a)  # -> out, a; same code as list_to_tree
panel_4 = Panel(list_to_tree_2.a)
viewer_3 = ParamViewer(list_to_tree_3.a)
