# Grasshopper definition train.gh (Grasshopper 1.0.8)
# plug-ins: CORE.Grasshopper.Colibri

range = Range(Domain=Domain(1, 10), Steps=10)
side = Panel(range)
toggle = BooleanToggle(False)
range_2 = Range(Domain=Domain(1, 10), Steps=10)
radius = Panel(range_2)
path = FilePath("G:\My Drive\CASE\Students\Courses\_All Semesters\DP2\Classes\Class 13 - Machine Learning\train_data.csv")
button = Button()
colibri_in = ColibriInputsIterator(R=button, Radius=radius, Side=side, ignoreAllWarningMsg=True)  # -> F, IP, Radius, Side, V_N
pt = ConstructPoint(XCoordinate=colibri_in.Radius, YCoordinate=colibri_in.Radius, ZCoordinate=0)
panel = Panel(colibri_in.Radius)
panel_2 = Panel(colibri_in.Side)
sph = Sphere(Base=PlaneXY(0, 0, 0), Radius=colibri_in.Radius)
box = CenterBox(Base=pt, X=colibri_in.Side, Y=colibri_in.Side, Z=colibri_in.Side)
sunion = SolidUnion(Breps=[sph, box])
volume = Volume(Geometry=sunion)  # -> Volume, Centroid
py3 = Python3Script(f=path, r=button, l=[colibri_in.Radius, colibri_in.Side, volume.Volume])  # -> out, a; inputs l: list
# ---------- py3: Python ----------
"""
train.py
--------
Input variables:
  f  — File path to write to
  r  — Boolean: False = reset (sets rs.sticky["reset"] = 0)
               True  = write or append based on rs.sticky["reset"]
  l  — List of values to append (used only when r is True)

rs.sticky["reset"] state:
  0 — file has not been initialised this session; next write will clear it first
  1 — file has been initialised; subsequent writes will append

Usage:
    Run inside Rhino/Grasshopper, or call train(f, r, l) directly.
"""

import scriptcontext


def train(f: str, r: bool, l: list) -> None:
    # Ensure the sticky key exists
    if "reset" not in scriptcontext.sticky:
        scriptcontext.sticky["reset"] = 0

    if not r:
        # Reset mode: mark session as not yet written
        scriptcontext.sticky["reset"] = 0
        print("scriptcontext.sticky['reset'] set to 0 — file will be cleared on next write.")
    else:
        if scriptcontext.sticky["reset"] == 0:
            # First write this session: clear the file, then mark as initialised
            with open(f, "w", encoding="utf-8") as file:
                file.write("")
            scriptcontext.sticky["reset"] = 1
            print(f"File cleared and initialised: {f}")
        else:
            # Subsequent writes: append CSV row
            row = ",".join(str(item) for item in l)
            with open(f, "a", encoding="utf-8") as file:
                file.write(row + "\n")
            print(f"Appended to {f}: {row}")


def main():
    # f = input("f — File path: ").strip()
    # if not f:
    #     raise SystemExit("No file path provided.")

    # r_input = input("r — Append? (True/False): ").strip().lower()
    # r = r_input in ("true", "1", "yes", "y")

    # if r:
    #     l_input = input("l — List values (comma-separated): ").strip()
    #     l = [item.strip() for item in l_input.split(",") if item.strip()]
    # else:
    #     l = []

    train(f=f, r=r, l=l)


if __name__ == "__main__":
    main()
# ---------- end py3 ----------
panel_3 = Panel(py3.out)
panel_4 = Panel(py3.a)
panel_5 = Panel(volume.Volume)
